# Grasshopper definition blobs.gh (Grasshopper 1.0.7)
# plug-ins: MarchingCubes, Kangaroo Components, Bifocals, Weaverbird, plankton

gene_pool = GenePool(Decimals=2, Maximum=100, Minimum=10, Value=[45.21, 79.01, 57.76, 60.67])
point = Point([Point(-69.92653245, -14.7758328, 0), Point(-13.77776416, 58.97176005, 0), Point(38.46385893, 0.4079300909, 0), Point(-8.955713774, -49.02054877, 0)])
curve = Curve([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])
point_charge = PointCharge(Point=point, Radius=gene_pool, ChargeStrength=Slider(1, range=-1..1))
curve_charge = CurveCharge(Curve=curve, Radius=Slider(13.1, range=0..100), ChargeStrengths=Slider(1, range=-1..1))
cocoon = Cocoon(
    Charges=[point_charge, curve_charge],
    Iso=Slider(0.25, range=0..1.1),
    CellSize=Slider(10.66, range=2..100),
    Execute=Toggle(True),
    Simple=False)  # -> Mesh, RefinementData
number_slider = Slider(16, range=0..100)
refine = Refine(
    RefinementData=cocoon.RefinementData,
    Samples=number_slider,
    SampleSize=Slider(8.5, range=0..10),
    SampleTolerance=Slider(0.01, range=0..0.01),
    LaplacianSmoothing=number_slider,
    ValencePasses=number_slider,
    SubD=Slider(1, range=0..100),
    Execute=Toggle(True))
mesh = Mesh(refine)
splitters = Splitters(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)
mesh_split = MeshSplit(Mesh=mesh, Splitters=splitters)
list_item = ListItem(List=mesh_split, Index=0, Wrap=True)
number_slider_2 = Slider(10, range=0..10)
weaverbird_s_naked_boundary = WeaverbirdsNakedBoundary(MeshClosedPolylines=list_item)
meshmachine = MeshMachine(
    Geometry=list_item,
    Length=Slider(6, range=6..12),
    FixCurves=weaverbird_s_naked_boundary,
    Flip=1,
    PullStrength=0.8,
    CurvatureAdaptivity=0,
    BoundaryScale=1,
    BoundaryDistance=5,
    Exponent=2,
    Background=0.5,
    Iterations=Slider(15, range=0..100),
    Reset=Toggle(False))
planktonmesh = PlanktonMesh(meshmachine)
number_slider_3 = Slider(6.4, range=0..10)
mesh_2 = Mesh(planktonmesh)
weaverbird_s_bevel_edges = WeaverbirdsBevelEdges(MeshPolylines=mesh_2, Distance=Slider(21.4, range=0..100), InsetType=0)
weaverbird_s_picture_frame = WeaverbirdsPictureFrame(MeshPolylines=mesh_2, Distance=number_slider_3, InsetType=0)
number_slider_4 = Slider(1.7, range=0..10)
weaverbird_s_mesh_window = WeaverbirdsMeshWindow(MeshPolylines=mesh_2, Distance=number_slider_3, InsetType=0)
weaverbird_s_mesh_thicken = WeaverbirdsMeshThicken(MeshCurves=weaverbird_s_mesh_window, Distance=number_slider_4, OffsetType=0)
weaverbird_s_mesh_thicken_2 = WeaverbirdsMeshThicken(MeshCurves=weaverbird_s_picture_frame, Distance=number_slider_4, OffsetType=0)
number_slider_5 = Slider(3, range=0..10)
weaverbird_s_catmull_clark_subdivision = WeaverbirdsCatmullClarkSubdivision(MeshCurves=weaverbird_s_mesh_thicken, Level=number_slider_5, SmoothNakedEdges=1)

# ----
# ^ Right click --> preview ^
weaverbird_s_catmull_clark_subdivision_2 = WeaverbirdsCatmullClarkSubdivision(MeshCurves=weaverbird_s_mesh_thicken_2, Level=number_slider_5, SmoothNakedEdges=1)
