# Grasshopper definition nanner.gh (Grasshopper 1.0.7)
# plug-ins: Kangaroo Components, Weaverbird, plankton

mesh_polylines = MeshPolylines(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)
meshmachine = MeshMachine(
    Geometry=mesh_polylines,
    Length=Slider(6.88, range=6..12),
    Flip=1,
    PullStrength=0.8,
    CurvatureAdaptivity=0,
    BoundaryScale=1,
    BoundaryDistance=5,
    Exponent=2,
    Background=0.5,
    Iterations=Slider(13, range=0..100),
    Reset=Toggle(False))
pmesh = PlanktonMesh(meshmachine)
mesh = Mesh(pmesh)
wbframe = WeaverbirdsPictureFrame(MeshPolylines=mesh, Distance=5, InsetType=0)
wbthicken = WeaverbirdsMeshThicken(MeshCurves=wbframe, Distance=Slider(2.23, range=0..10), OffsetType=0)
wbcatmullclark = WeaverbirdsCatmullClarkSubdivision(MeshCurves=wbthicken, Level=Slider(3.19, range=0..10), SmoothNakedEdges=1)
