# Grasshopper definition sphere.gh (Grasshopper 1.0.7)
# plug-ins: Weaverbird

msphere = MeshSphere(Base=PlaneXY(0, 0, 0), Radius=Slider(26, range=0..100), UCount=10, VCount=20)
wbmidedge = WeaverbirdsMidedgeSubdivision(MeshCurves=msphere, Level=1, SmoothNakedEdges=1)
wbframe = WeaverbirdsPictureFrame(MeshPolylines=wbmidedge, Distance=5, InsetType=0)
wbthicken = WeaverbirdsMeshThicken(MeshCurves=wbframe, Distance=Slider(1.8, range=0..5), OffsetType=0)
wbcatmullclark = WeaverbirdsCatmullClarkSubdivision(MeshCurves=wbthicken, Level=Slider(11.9, range=0..25), SmoothNakedEdges=1)
