# Grasshopper definition lattice.gh (Grasshopper 1.0.7)
# plug-ins: MarchingCubes, Weaverbird

boxsize = Slider(17, range=0..30)
number_slider = Slider(3, range=0..10)
rectangle = Rectangle(Plane=PlaneXY(0, 0, 0), XSize=boxsize, YSize=boxsize, Radius=0)  # -> Rectangle, Length
division = Division(A=boxsize, B=2)
boxrec = BoxRectangle(Rectangle=rectangle.Rectangle, Height=boxsize)
neg = Negative(Value=division)
pt = ConstructPoint(XCoordinate=neg, YCoordinate=neg, ZCoordinate=neg)
move = Move(Geometry=boxrec, Motion=pt)  # -> Geometry, Transform
scale = Scale(Geometry=move.Geometry, Center=Point(0, 0, 0), Factor=Slider(1.3, range=1..2))  # -> Geometry, Transform
mbox = MeshBox(Base=scale.Geometry, XCount=number_slider, YCount=number_slider, ZCount=number_slider)

# ----
# Randomly generated points within box
pop3d = Populate3D(Region=move.Geometry, Count=Slider(20, range=5..100), Seed=Slider(37, range=0..100))

# ----
# Array of points aroung box
wbvertices = WeaverbirdsVerticesComponent(MeshClosedPolylinesGroup=mbox, Weld=True)

prox = Proximity3D(
    Points=[wbvertices, pop3d],
    Group=Slider(8, range=2..10),
    MinRadius=Slider(3.003, range=0..10),
    MaxRadius=Slider(8.725, range=-0.001..20))  # -> Links, Topology
panel = Panel("Connect nearby points")

curve_charge = CurveCharge(Curve=prox.Links, Radius=Slider(1.2, range=0.5..16.5), ChargeStrengths=Slider(1, range=-1..1))

# ----
# Melded lattice structure (right click --> preview)
cocoon = Cocoon(
    Charges=curve_charge,
    Iso=Slider(0.4, range=0..1.1),
    CellSize=Slider(0.278, range=-0.001..1),
    Execute=Toggle(True),
    Simple=False)  # -> Mesh, RefinementData
